vi "index.gviweb"   [LabVIEW NXG 5.0.0]
panel controls:
  "Timezone": string
  "LV Enabled": bool = TRUE
  "LV TZ Update": bool
  "LV OS TZ Update": bool = TRUE
  "Pi OS TZ Update": bool = TRUE
  "LV OS Enabled": bool = TRUE
  "Pi OS Enabled": bool = TRUE
  "Debug Log?": bool
panel indicators:
  "Connected?": bool
  "LabVIEW Time": string
  "WebSockets URL": string
  "Last Error": string
  "LabVIEW OS Time": string
  "PI OS Time": string
types:
  T1 = cluster{"WebSockets URL": string, "WebSocket Session": u32, "Connected?": bool, "Message In": string, "Message Out": string, "LV TZ Update?": bool, "LV Time Update?": bool, "LV Time": string, "LV OS TZ Update?": bool, "LV OS Time Update?": bool, "LV OS Time": string, "Pi OS TZ Update?": bool, "Pi OS Time Update?": bool, "Pi OS Time": string, "State Control Refs": "CheckBox reference"[], "Debug Log?": bool}
  T2 = cluster{"Command": string, "Controls": cluster{"Name": string, "Value": bool}[]}
uses:
  JKI::Library::JKI State Machine::Add State(s) to Queue.gvi
  JKI::Library::JKI State Machine::Parse State Queue.gvi
  NI::G Core::Error::Build Error Cluster.gvi
  DebugTools::Debug Log.gvi
  WebApp::GetHostname.jsli::GetHostname
  NI::WebSockets::Close WebSocket.gvi
  NI::G Core::Error::Clear Error Cluster.gvi
  NI::WebSockets::Open WebSocket.gvi
  NI::WebSockets::Read String.gvi
  NI::WebSockets::Write String.gvi
diagram:
  call "Add State(s) to Queue.gvi"(State(s) in ("")="Macro: Initialize") -> (States Out=w1)
  # This has been modified from the JKI State Machine NXG 3.0 available at https://github.com/JKISoftware/JKI-State-Machine-NXG/tree/master/source.  Instead of building a package the required VIs have been added to this project.  The items not supported by a Web VI have been removed.
  # = State Syntax =
  # StateCategory: State >> Argument
  # Line Terminator: Line feed
  # Example:
  # UI: Help >> About
  #
  # Where "UI" is the state category
  # Where "Help" is the state
  # Where "About" is the argument
  # Other Examples:
  # App Data: Initialize
  # UI: Initialize
  # Help >> About
  #
  # = Commenting =
  # To add a comment use "//" or "#" and all text to the right will be ignored
  # Commenting Example:
  # UI: Initialize // This initializes the UI
  # # This whole line is a comment
  # // Another comment line
  # For instructions on how to use the JKI State Machine, examples and video tutorials, visit:
  # http://jki.net/state-machine/
  #
  # JKI State Machine™
  # http://jki.net/state-machine/
  # Copyright (C) 2005-2018, JKI <info@jki.net>
  # ALL RIGHTS RESERVED
  s1 = uninitialised  # shift register
  s2 = uninitialised  # shift register
  s3 = w1  # shift register
  while {
    call "Parse State Queue.gvi"(State Queue=s3, Error In (no error)=s2) -> (Remaining States=w2, Current State=w3, Arguments=w4)
    w5 = 10  # Timeout
    # JKI State Machine NXG 3.0				Template Copyright © 2018 JKI	 - http://jki.net/state-machine
    # -1 =
    # wait
    # forever
    case (w3) ignore case {
      frame "", "Event Structure", "Idle" {
        # executes when the state queue is empty
        event (timeout = w5) {
          on "Timeout" {
            Property Node(instance in=s1) -> ("Connected?"=w10)
            Select(s=w10, t="Comm: Read", f="Comm: Connecting") -> w11
            # Timeout Frame
            # (this will only execute if the Event Structure timeout is >= 0)
            call "Add State(s) to Queue.gvi"(State(s) in Front ("")=w11, State(s) in ("")=w2, State(s) at Back ("")="UI: Update") -> (States Out=w7)
            w6 = s2
            w9 = s1
          }
          on "Timezone" Value changed {
            call "Add State(s) to Queue.gvi"(State(s) in Front ("")="UI: Process Timezone", State(s) in ("")=w2) -> (States Out=w7)
            w6 = s2
            w9 = s1
          }
          on "LV Enabled" Value changed; "LV OS Enabled" Value changed; "LV OS TZ Update" Value changed; "LV TZ Update" Value changed; "Pi OS Enabled" Value changed; "Pi OS TZ Update" Value changed {
            Event Data() -> ("New Value"=w12, "Control Reference"=w13)
            Property Node(instance in=w13) -> ("Label"=w14)
            Property Node(instance in=w14) -> ("Text"=w15)
            Format Into String(formatString="UI: Process Boolean >> %s,%s", w15, w12) -> w16
            call "Add State(s) to Queue.gvi"(State(s) in Front ("")=w16, State(s) in ("")=w2) -> (States Out=w7)
            w6 = s2
            w9 = s1
          }
          on "Debug Log?" Value changed {
            Event Data() -> ("New Value"=w17)
            Property Node(instance in=s1, "Debug Log?"=w17) -> (instance out=w9)
            w7 = w2
            w6 = s2
          }
        }
        w8 = default
      }
      frame "---------- Core ----------" {
        # Do not put any code in this frame.
        # (it is a separator no-op)
        call "Add State(s) to Queue.gvi"(State(s) in ("")=w2) -> (States Out=w7)
        w6 = s2
        w8 = default
        w9 = s1
      }
      frame Default {
        # Do not delete, rename, or modify this frame.
        # (this is used to capture unhandled states and typos)
        call "Add State(s) to Queue.gvi"(State(s) in ("")=w2) -> (States Out=w7)
        Format Into String(formatString="Software Exception: Unhandled State \"%s\".", errIn=s2, w3) -> (outString=w18, errOut=w19)
        # Handle mistyped state name (developer tool)
        call "Build Error Cluster.gvi"(code="Generic error"(42), description=w18, error in=w19, include call chain=TRUE) -> (error out=w6)
        w8 = default
        w9 = s1
      }
      frame "Error Handler" {
        # Handle any errors here.
        # You can also output any states to clean-up after errors occur
        call "Add State(s) to Queue.gvi"(State(s) in Front ("")="/* Post Error States", State(s) in ("")=w2) -> (States Out=w7)
        Property Node(instance in=s2) -> ("code"=w20, "source"=w21)
        # Unhandled Error -- Display it
        Get Current Time() -> (current time=w22)
        Format Into String(formatString="%<%c>T\nCode: %d\n%s", w22, w20, w21) -> w23
        $"Last Error" <- w23
        # Clear error
        w6 = no error
        w8 = default
        w9 = s1
      }
      frame "Exit" {
        # Do not put any code in this frame.
        # (No errors that occur here will be handled.)
        call "Add State(s) to Queue.gvi"(State(s) in ("")=w2) -> (States Out=w7)
        w24 = TRUE  # Stop
        w6 = s2
        w8 = w24
        w9 = s1
      }
      frame "---------- Data ----------" {
        # Do not put any code in this frame.
        # (It is a separator no-op. You can make a copy of this frame to create a new Data frame)
        call "Add State(s) to Queue.gvi"(State(s) in ("")=w2) -> (States Out=w7)
        w6 = s2
        w8 = default
        w9 = s1
      }
      frame "Data: Initialize" {
        # Initialize the shift-register data, here.
        # (data names are defined by what you wire into the bundle function)
        call "Add State(s) to Queue.gvi"(State(s) in ("")=w2) -> (States Out=w7)
        # Add new data here.
        w25 = T1 {"LV Time Update?"=TRUE, "LV OS TZ Update?"=TRUE, "LV OS Time Update?"=TRUE, "Pi OS TZ Update?"=TRUE, "Pi OS Time Update?"=TRUE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}
        Build Array(reference to "LV Enabled", reference to "LV OS Enabled", reference to "Pi OS Enabled", reference to "LV TZ Update", reference to "LV OS TZ Update", reference to "Pi OS TZ Update") -> w26
        # Data names and types of shift register data are defined by this bundle.
        Property Node(instance in=w25, "State Control Refs"=w26) -> (instance out=w9)
        w6 = s2
        w8 = default
      }
      frame "Data: Cleanup" {
        # Cleanup any data and references, here.
        # (this is called automatically, by the Macro: Exit)
        call "Add State(s) to Queue.gvi"(State(s) in ("")=w2) -> (States Out=w7)
        w6 = s2
        w8 = default
        w9 = s1
      }
      frame "---------- UI ----------" {
        # Do not put any code in this frame.
        # (It is a separator no-op. You can make a copy of this frame to create a new UI frame)
        call "Add State(s) to Queue.gvi"(State(s) in ("")=w2) -> (States Out=w7)
        w6 = s2
        w8 = default
        w9 = s1
      }
      frame "UI: Initialize" {
        # Initialize the User Interface, here.
        # (this is called automatically, by the Macro: Init)
        call "Add State(s) to Queue.gvi"(State(s) in ("")=w2) -> (States Out=w7)
        $"Last Error" <- ""
        Property Node(instance in=s1) -> ("Debug Log?"=w27, "State Control Refs"=w28, "LV Time Update?"=w29, "LV OS Time Update?"=w30, "Pi OS Time Update?"=w31, "LV TZ Update?"=w32, "LV OS TZ Update?"=w33, "Pi OS TZ Update?"=w34)
        Property Node(instance in=reference to "Debug Log?", "Value"=w27)
        Build Array(w29, w30, w31, w32, w33, w34) -> w35
        for {
          w36 = each element of w28
          w37 = each element of w35
          Property Node(instance in=w36, "Value"=w37)
        }
        w6 = s2
        w8 = default
        w9 = s1
      }
      frame "UI: Update" {
        # Update the User Interface, here.
        # (this is called automatically, by the Macro: Init and during Timeout)
        call "Add State(s) to Queue.gvi"(State(s) in ("")=w2) -> (States Out=w7)
        Property Node(instance in=s1) -> ("WebSockets URL"=w38, "Connected?"=w39, "LV Time"=w40, "LV OS Time"=w41, "Pi OS Time"=w42)
        $"WebSockets URL" <- w38
        $"Connected?" <- w39
        $"LabVIEW Time" <- w40
        $"LabVIEW OS Time" <- w41
        $"PI OS Time" <- w42
        w6 = s2
        w8 = default
        w9 = s1
      }
      frame "UI: Process Timezone" {
        # UI: Process Timezone
        # (Process the Timezone change from the UI.)
        call "Add State(s) to Queue.gvi"(State(s) in ("")=w2, State(s) at Back ("")="Comm: Write") -> (States Out=w7)
        Property Node(instance in=reference to "Timezone", error in=s2) -> ("Value"=w43, error out=w44)
        w45 = cluster{"Command": string, "Timezone": string} {all zero or empty}
        Property Node(instance in=w45, "Command"="Timezone", "Timezone"=w43) -> (instance out=w46)
        Flatten To Json(anything=w46, error in (no error)=w44) -> (JSON string=w47, error out=w6)
        Property Node(instance in=s1, "Message Out"=w47) -> ("Debug Log?"=w48, instance out=w9)
        case (w48) {
          frame False, Default { }
          frame True {
            call "Debug Log.gvi"(prefix=w3, value=w9)
          }
        }
        w8 = default
      }
      frame "UI: Process Web UI State" {
        # UI: Process Web UI State
        # (Get the current state of the state controls and send to the program.)
        call "Add State(s) to Queue.gvi"(State(s) in Front ("")="Comm: Write", State(s) in ("")=w2) -> (States Out=w7)
        Property Node(instance in=s1) -> ("State Control Refs"=w49)
        s4 = s2  # shift register
        for {
          w50 = each element of w49
          Property Node(instance in=w50, error in=s4) -> ("Value"=w52, "Label"=w53, error out=w54)
          Property Node(instance in=w53, error in=w54) -> ("Text"=w55, error out=w56)
          Property Node(instance in=cluster{"Name": string, "Value": bool} {all zero or empty}, "Name"=w55, "Value"=w52) -> (instance out=w57)
          append w57 to w51
          next s4 = w56
        }
        Property Node(instance in=T2 {all zero or empty}, "Command"="Web UI State", "Controls"=w51) -> (instance out=w58)
        Flatten To Json(anything=w58, error in (no error)=s4) -> (JSON string=w59, error out=w6)
        Property Node(instance in=s1, "Message Out"=w59) -> (instance out=w9)
        w8 = default
      }
      frame "UI: Process Boolean" {
        # UI: Process Boolean
        # (Process a boolean change from the UI.)
        call "Add State(s) to Queue.gvi"(State(s) in ("")=w2, State(s) at Back ("")="Comm: Write") -> (States Out=w7)
        Search Or Split String(search string/char=",", string=w4) -> (match + rest of string=w60, substring before match=w61)
        String Subset(offset (0)=1, string=w60) -> w62
        Scan From String(inputString=w62, default=FALSE) -> (out0=w63)
        w64 = cluster{"Command": string, "Enabled?": bool} {all zero or empty}
        Property Node(instance in=w64, "Command"=w61, "Enabled?"=w63) -> (instance out=w65)
        Flatten To Json(anything=w65, error in (no error)=s2) -> (JSON string=w66, error out=w6)
        Property Node(instance in=s1, "Message Out"=w66) -> ("Debug Log?"=w67, instance out=w9)
        case (w67) {
          frame False, Default { }
          frame True {
            call "Debug Log.gvi"(prefix=w3, value=w9)
          }
        }
        w8 = default
      }
      frame "UI: Process LV Time" {
        # UI: Process LV Time
        # (Process the LV Time Update.)
        call "Add State(s) to Queue.gvi"(State(s) in ("")=w2) -> (States Out=w7)
        Property Node(instance in=s1) -> ("Message In"=w68, instance out=w69)
        Unflatten From Json(JSON string=w68, error in (no error)=s2, path=["LV Time"], type and defaults=string "") -> (error out=w6, value=w70)
        Property Node(instance in=w69, "LV Time"=w70) -> (instance out=w9)
        w8 = default
      }
      frame "UI: Process LV OS Time" {
        # UI: Process LV OS Time
        # (Process the LV OS Time Update.)
        call "Add State(s) to Queue.gvi"(State(s) in ("")=w2) -> (States Out=w7)
        Property Node(instance in=s1) -> ("Message In"=w71, instance out=w72)
        Unflatten From Json(JSON string=w71, error in (no error)=s2, path=["LV OS Time"], type and defaults=string "") -> (error out=w6, value=w73)
        Property Node(instance in=w72, "LV OS Time"=w73) -> (instance out=w9)
        w8 = default
      }
      frame "UI: Process Pi OS Time" {
        # UI: Process Pi OS Time
        # (Process the Pi OS Time Update.)
        call "Add State(s) to Queue.gvi"(State(s) in ("")=w2) -> (States Out=w7)
        Property Node(instance in=s1) -> ("Message In"=w74, instance out=w75)
        Unflatten From Json(JSON string=w74, error in (no error)=s2, path=["Pi OS Time"], type and defaults=string "") -> (error out=w6, value=w76)
        Property Node(instance in=w75, "Pi OS Time"=w76) -> (instance out=w9)
        w8 = default
      }
      frame "---------- Macro ----------" {
        # Do not put any code in this frame.
        # (It is a separator no-op. You can make a copy of this frame to create a new Macro frame)
        call "Add State(s) to Queue.gvi"(State(s) in ("")=w2) -> (States Out=w7)
        w6 = s2
        w8 = default
        w9 = s1
      }
      frame "Macro: Initialize" {
        w77 = "Data: Initialize\nUI: Initialize\nUI: Update\nComm: Initialize\nUI: Update"
        # Initialization Macro
        # (This is called once, when the VI starts)
        call "Add State(s) to Queue.gvi"(State(s) in Front ("")=w77, State(s) in ("")=w2) -> (States Out=w7)
        w6 = s2
        w8 = default
        w9 = s1
      }
      frame "Macro: Exit" {
        # Exit Macro
        # (This is called once, when the VI exits)
        call "Add State(s) to Queue.gvi"(State(s) in Front ("")="Data: Cleanup\nExit", State(s) in ("")=w2) -> (States Out=w7)
        w6 = s2
        w8 = default
        w9 = s1
      }
      frame "---------- Comm ----------" {
        # Template Separator
        # (You can make a copy of, or modify, this frame)
        call "Add State(s) to Queue.gvi"(State(s) in ("")=w2) -> (States Out=w7)
        w6 = s2
        w8 = default
        w9 = s1
      }
      frame "Comm: Initialize" {
        # Comm: Initialize
        # (Establishes a connection with the webserver.)
        call "Add State(s) to Queue.gvi"(State(s) in ("")=w2) -> (States Out=w7)
        # Change this according to whether it's being hosted on the Pi (e.g. localhost) or you are accessing remotely (Pi IP address)
        disable {
          frame Disabled {
            # Use to test running locally.
            w78 = "ws://labviewpi:6123"
          }
          frame Enabled {
            call "GetHostname"() -> (return=w79, error out=w80)
            Format Into String(formatString="ws://%s:6123", errIn=w80, w79) -> (outString=w78, errOut=w6)
          }
        }
        Property Node(instance in=s1, "WebSockets URL"=w78) -> (instance out=w9)
        w8 = default
      }
      frame "Comm: Connecting" {
        # Comm: Connecting
        # (Establish a WebSockets connection.)
        call "Add State(s) to Queue.gvi"(State(s) in ("")=w2) -> (States Out=w7)
        Property Node(instance in=s1) -> ("WebSockets URL"=w81, "WebSocket Session"=w82, instance out=w83)
        call "Close WebSocket.gvi"(websocket session in=w82, error in=s2) -> (error out=w84)
        call "Clear Error Cluster.gvi"(error in=w84) -> (error out=w85)
        call "Open WebSocket.gvi"(url=w81, error in=w85) -> (websocket session out=w86, error out=w87)
        Not(x=w87) -> w88
        Property Node(instance in=w83, "WebSocket Session"=w86, "Connected?"=w88) -> (instance out=w9)
        call "Clear Error Cluster.gvi"(error in=w87) -> (error out=w6)
        w8 = default
      }
      frame "Comm: Read" {
        Property Node(instance in=s1) -> ("WebSocket Session"=w89, instance out=w90)
        call "Read String.gvi"(websocket session in=w89, timeout=5, error in=s2) -> (websocket session out=w91, string response=w92, error out=w93)
        # Comm: Read
        # (Read any available message.)
        Select(s=w93, t="", f="Comm: Process") -> w94
        call "Add State(s) to Queue.gvi"(State(s) in Front ("")=w94, State(s) in ("")=w2) -> (States Out=w7)
        Not(x=w93) -> w95
        Property Node(instance in=w90, "WebSocket Session"=w91, "Message In"=w92, "Connected?"=w95) -> (instance out=w9)
        call "Clear Error Cluster.gvi"(error in=w93) -> (error out=w6)
        w8 = default
      }
      frame "Comm: Write" {
        # Comm: Write
        # (Write available message.)
        call "Add State(s) to Queue.gvi"(State(s) in ("")=w2) -> (States Out=w7)
        Property Node(instance in=s1) -> ("WebSocket Session"=w96, "Message Out"=w97, instance out=w98)
        call "Write String.gvi"(websocket session in=w96, string message=w97, error in=s2) -> (websocket session out=w99, error out=w100)
        Not(x=w100) -> w101
        Property Node(instance in=w98, "WebSocket Session"=w99, "Connected?"=w101) -> (instance out=w9)
        call "Clear Error Cluster.gvi"(error in=w100) -> (error out=w6)
        w8 = default
      }
      frame "Comm: Process" {
        Property Node(instance in=s1) -> ("Message In"=w102)
        Unflatten From Json(JSON string=w102, error in (no error)=s2, path=["Command"], type and defaults=string "") -> (error out=w103, value=w104)
        Format Into String(formatString="UI: Process %s", errIn=w103, w104) -> (outString=w105, errOut=w6)
        # Comm: Process
        # (Process message.)
        call "Add State(s) to Queue.gvi"(State(s) in Front ("")=w105, State(s) in ("")=w2) -> (States Out=w7)
        w8 = default
        w9 = s1
      }
    }
    next s1 = w9
    next s2 = w6
    next s3 = w7
    stop if w8
  }
